# Grasshopper definition debug.gh (Grasshopper 0.9.76)
# plug-ins: Radical

number_slider = Slider(0.179, range=0..1)
number_slider_2 = Slider(0.37, range=0..1)
dgeg = Slider(0.86, range=0..1)
number_slider_3 = Slider(0.463, range=0..1)
number_slider_4 = Slider(0.37, range=0..1)
srf = Surface(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)
graph = GraphMapper(
    dgeg,
    x0=0,
    x1=1,
    y0=0,
    y1=1,
    container_name="Sinc",
    Equation_X0=0.4273509085,
    Equation_X1=0.7434785366,
    Equation_Y0=0.9422633648,
    Equation_Y1=0.7391304374)
graph_2 = GraphMapper(
    number_slider_2,
    x0=0,
    x1=1,
    y0=0,
    y1=1,
    container_name="Sinc",
    Equation_X0=0.3695652187,
    Equation_X1=0.7434785366,
    Equation_Y0=0.06376802921,
    Equation_Y1=0.7391304374)
graph_3 = GraphMapper(
    number_slider,
    x0=0,
    x1=1,
    y0=0,
    y1=1,
    container_name="Sinc",
    Equation_X0=0.5805619955,
    Equation_X1=0.7434785366,
    Equation_Y0=0.7237856388,
    Equation_Y1=0.7391304374)
graph_4 = GraphMapper(
    number_slider_3,
    x0=0,
    x1=1,
    y0=0,
    y1=1,
    container_name="Sinc",
    Equation_X0=0.4650463164,
    Equation_X1=0.7434785366,
    Equation_Y0=0.366582036,
    Equation_Y1=0.7391304374)
mm = MassMultiplication(Input=[graph_2, graph_3, graph_4, graph])  # -> Result, PartialResults
rad = Radical(Objective=mm.Result, NumericalVariables=[dgeg, number_slider_3, number_slider, number_slider_2], SrfVar=srf)
galapagos = Galapagos(gene=[number_slider_3, dgeg, number_slider, number_slider_2])
